# Grasshopper definition pier.gh (Grasshopper 1.0.7)

deplane = DeconstructPlane(Plane=PlaneXY(0, 0, 0))  # -> Origin, XAxis, YAxis, ZAxis
Z = UnitZ(Factor=Slider(2023, range=0..10000))
move = Move(Geometry=deplane.Origin, Motion=expr("-x", Z))  # -> Geometry, Transform
X = UnitX(Factor=Slider(1103, range=0..10000))
Z_2 = UnitZ(Factor=Slider(1124, range=0..10000))
move_2 = Move(Geometry=move.Geometry, Motion=expr("-x", X))  # -> Geometry, Transform
move_3 = Move(Geometry=move.Geometry, Motion=X)  # -> Geometry, Transform
move_4 = Move(Geometry=move.Geometry, Motion=expr("-x", Z_2))  # -> Geometry, Transform
move_5 = Move(Geometry=move_4.Geometry, Motion=expr("-x", Z_2))  # -> Geometry, Transform
