# Grasshopper definition rebar_geometrical.gh (Grasshopper 1.0.7)

recgrid = Rectangular(Plane=PlaneXY(0, 0, 0), SizeX=Slider(1066, range=0..10000), SizeY=Slider(1139, range=0..10000), ExtentX=1, ExtentY=1)  # -> Cells, Points
Z = UnitZ(Factor=Slider(4782, range=0..10000))
number_slider = Slider(400, range=0..1000)
extr = Extrude(Base=recgrid.Cells, Direction=Z)
debox = DeconstructBox(Box=extr)  # -> Plane, X, Y, Z
debrep = DeconstructBrep(Brep=extr)  # -> Faces, Edges, Vertices
srf = Surface(debrep.Faces)
range = Range(Domain=debox.Z, Steps=10)
offset = OffsetSurface(Surface=srf, Distance=Slider(60, range=-100..1000), Retrim=True)
panel = Panel(offset)
panel_2 = Panel(debrep.Edges)
item = ListItem(List=offset, Index=Slider(1, range=0..10), Wrap=True)
item_2 = ListItem(List=offset, Index=Slider(2, range=0..10), Wrap=True)
item_3 = ListItem(List=offset, Index=Slider(3, range=0..10), Wrap=True)
item_4 = ListItem(List=offset, Index=Slider(4, range=0..10), Wrap=True)
pl_offset = PlaneOffset(BasePlane=debox.Plane, Offset=Z)
sec = BrepPlane(Brep=extr, Plane=pl_offset)  # -> Curves, Points
bbx = BrepBrep(BrepA=item, BrepB=item_2)  # -> Curves, Points
bbx_2 = BrepBrep(BrepA=item_2, BrepB=item_3)  # -> Curves, Points
bbx_3 = BrepBrep(BrepA=item, BrepB=item_4)  # -> Curves, Points
bbx_4 = BrepBrep(BrepA=item_3, BrepB=item_4)  # -> Curves, Points
offset_2 = OffsetCurve(Curve=sec.Curves, Distance=Slider(-125, range=-300..300), Plane=PlaneXY(0, 0, 0), Corners=1)
offset_3 = OffsetCurve(Curve=offset_2, Distance=Slider(-115, range=-300..300), Plane=PlaneXY(0, 0, 0), Corners=1)
wires = BrepWireframe(Brep=offset_3, Density=-1)
panel_3 = Panel(wires)

divide = DivideCurve(Curve=wires, Count=Slider(10, range=0..100), Kinks=False)  # -> Points, Tangents, Parameters
project = Project(Geometry=divide.Points, Plane=debox.Plane)  # -> Geometry, Transform
ln = Line(StartPoint=divide.Points, EndPoint=project.Geometry)
number_slider_2 = Slider(3, range=0..10)
lng = ListLength(List=divide.Points)
ext = ExtendCurve(Curve=ln, Type=0, Start=Slider(400, range=0..1000), End=Slider(-400, range=-4000..4000.001))
panel_4 = Panel(lng)

number_slider_3 = Slider(5, range=0..20)
expression = Expression(x=number_slider_3, Expression="x*½")
expression_2 = Expression(x=number_slider_3, Expression="x*⅓")
panel_5 = Panel(expression)
panel_6 = Panel(expression_2)
curvepoint = PointOnCurve(bbx_4.Curves, parameter=0)
curvepoint_2 = PointOnCurve(bbx_2.Curves, parameter=0)
curvepoint_3 = PointOnCurve(bbx_3.Curves, parameter=1)
curvepoint_4 = PointOnCurve(bbx.Curves, parameter=0)
curvepoint_5 = PointOnCurve(bbx_4.Curves, parameter=0)
curvepoint_6 = PointOnCurve(bbx_3.Curves, parameter=1)
curvepoint_7 = PointOnCurve(bbx.Curves, parameter=0)
curvepoint_8 = PointOnCurve(bbx_2.Curves, parameter=0)
ln_2 = Line(StartPoint=curvepoint_7, EndPoint=curvepoint_8)
ln_3 = Line(StartPoint=curvepoint_3, EndPoint=curvepoint_5)
ln_4 = Line(StartPoint=curvepoint_2, EndPoint=curvepoint)
ln_5 = Line(StartPoint=curvepoint_4, EndPoint=curvepoint_6)
line = Line([ln_2, ln_3, ln_4, ln_5])
pline = PolyLine(Closed=False)

divide_2 = DivideCurve(Curve=ln_4, Count=Slider(6, range=0..100), Kinks=False)  # -> Points, Tangents, Parameters
project_2 = Project(Geometry=divide_2.Points, Plane=debox.Plane)  # -> Geometry, Transform
ln_6 = Line(StartPoint=divide_2.Points, EndPoint=project_2.Geometry)
lng_2 = ListLength(List=divide_2.Points)
ext_2 = ExtendCurve(Curve=ln_6, Type=0, Start=Slider(400, range=0..1000), End=Slider(-400, range=-4000..4000.001))
division = Division(A=lng_2, B=Slider(3, range=0..10))
panel_7 = Panel(division)

divide_3 = DivideCurve(Curve=ln_5, Count=Slider(6, range=0..100), Kinks=False)  # -> Points, Tangents, Parameters
project_3 = Project(Geometry=divide_3.Points, Plane=debox.Plane)  # -> Geometry, Transform
ln_7 = Line(StartPoint=divide_3.Points, EndPoint=project_3.Geometry)
lng_3 = ListLength(List=divide_3.Points)
ext_3 = ExtendCurve(Curve=ln_7, Type=0, Start=Slider(400, range=0..1000), End=Slider(-400, range=-4000..4000.001))
division_2 = Division(A=lng_3, B=Slider(3, range=0..10))
panel_8 = Panel(division_2)

divide_4 = DivideCurve(Curve=ln_3, Count=Slider(7, range=0..100), Kinks=False)  # -> Points, Tangents, Parameters
project_4 = Project(Geometry=divide_4.Points, Plane=debox.Plane)  # -> Geometry, Transform
ln_8 = Line(StartPoint=divide_4.Points, EndPoint=project_4.Geometry)
lng_4 = ListLength(List=divide_4.Points)
ext_4 = ExtendCurve(Curve=ln_8, Type=0, Start=Slider(400, range=0..1000), End=Slider(-400, range=-4000..4000.001))
division_3 = Division(A=lng_4, B=Slider(3, range=0..10))
panel_9 = Panel(division_3)

# ---- group: 检测间距
item_5 = ListItem(List=divide_4.Points, Index=Slider(1, range=0..1), Wrap=True)
item_6 = ListItem(List=divide_4.Points, Index=Slider(2, range=0..10), Wrap=True)
dist = Distance(PointA=item_5, PointB=item_6)
panel_10 = Panel(dist)
