# Grasshopper definition rebar_geometrical2.gh (Grasshopper 1.0.7)

recgrid = Rectangular(Plane=PlaneXY(0, 0, 0), SizeX=Slider(1800, range=0..10000), SizeY=Slider(1800, range=0..10000), ExtentX=1, ExtentY=1)  # -> Cells, Points
Z = UnitZ(Factor=Slider(5185, range=0..50000))
extr = Extrude(Base=recgrid.Cells, Direction=Z)
debox = DeconstructBox(Box=extr)  # -> Plane, X, Y, Z
debrep = DeconstructBrep(Brep=extr)  # -> Faces, Edges, Vertices

number_slider = Slider(550, range=0..1000)
number_slider_2 = Slider(79, range=0..1000)
int = Integer(1)
int_2 = Integer(3)
int_3 = Integer(2)
int_4 = Integer(4)
item = ListItem(List=debrep.Faces, Index=int, Wrap=True)
item_2 = ListItem(List=debrep.Faces, Index=int_2, Wrap=True)
item_3 = ListItem(List=debrep.Faces, Index=int_3, Wrap=True)
item_4 = ListItem(List=debrep.Faces, Index=int_4, Wrap=True)
offset = OffsetSurface(Surface=item, Distance=number_slider, Retrim=True)
offset_2 = OffsetSurface(Surface=item_2, Distance=number_slider, Retrim=True)
offset_3 = OffsetSurface(Surface=item_3, Distance=number_slider_2, Retrim=True)
offset_4 = OffsetSurface(Surface=item_4, Distance=number_slider_2, Retrim=True)
bbx = BrepBrep(BrepA=graft(offset), BrepB=offset_3)  # -> Curves, Points
bbx_2 = BrepBrep(BrepA=graft(offset_2), BrepB=offset_3)  # -> Curves, Points
bbx_3 = BrepBrep(BrepA=graft(offset_2), BrepB=offset_4)  # -> Curves, Points
bbx_4 = BrepBrep(BrepA=graft(offset), BrepB=offset_4)  # -> Curves, Points
plx = LinePlane(Line=[bbx.Curves, bbx_2.Curves, bbx_3.Curves, bbx_4.Curves], Plane=debox.Plane)  # -> Point, ParamL, ParamP
pline = PolyLine(Vertices=plx.Point, Closed=True)
int_5 = Integer(50)
fillet = Fillet(Curve=pline, Radius=Slider(42, range=0..100))
Z_2 = UnitZ(Factor=int_5)
move = Move(Geometry=fillet, Motion=Z_2)  # -> Geometry, Transform

panel = Panel(debox.Plane)
srf = Surface(debrep.Faces)  # disabled

top_plane = PlaneOffset(BasePlane=debox.Plane, Offset=Z)
int_6 = Integer(-50)
panel_2 = Panel(top_plane)
保护层厚度 = Slider(-53, range=-300..300)
Z_3 = UnitZ(Factor=int_6)
sec = BrepPlane(Brep=extr, Plane=top_plane)  # -> Curves, Points
move_2 = Move(Geometry=sec.Curves, Motion=Z_3)  # -> Geometry, Transform
pcen = PolygonCenter(Polyline=sec.Curves)  # -> CenterV, CenterE, CenterA
箍筋 = OffsetCurve(Curve=move_2.Geometry, Distance=保护层厚度, Plane=PlaneXY(0, 0, 0), Corners=1)
project = Project(Geometry=pcen.CenterV, Plane=debox.Plane)  # -> Geometry, Transform
wires = BrepWireframe(Brep=箍筋, Density=-1)
ln = Line(StartPoint=pcen.CenterV, EndPoint=project.Geometry)
offset_5 = OffsetCurve(Curve=箍筋, Distance=Slider(-55, range=-300..300), Plane=PlaneXY(0, 0, 0), Corners=1)
wires_2 = BrepWireframe(Brep=offset_5, Density=-1)

panel_3 = Panel(debrep.Edges)
加密区间距 = Slider(-100, range=-1000..1000)

int_7 = Integer(50)
Z_4 = UnitZ(Factor=int_7)
move_3 = Move(Geometry=debox.Plane, Motion=Z_4)  # -> Geometry, Transform

number_slider_3 = Slider(16, range=0..50)
Z_5 = UnitZ(Factor=expr("x", 加密区间距))
Z_6 = UnitZ(Factor=expr("-x", 加密区间距))
int_8 = Integer(-50)
project_2 = Project(Geometry=move.Geometry, Plane=top_plane)  # -> Geometry, Transform
number_slider_4 = Slider(68, range=0..100)
panel_4 = Panel(move_3.Geometry)
Z_7 = UnitZ(Factor=int_8)
arrlinear = LinearArray(Geometry=move.Geometry, Direction=Z_6, Count=number_slider_3)  # -> Geometry, Transform
move_4 = Move(Geometry=project_2.Geometry, Motion=Z_7)  # -> Geometry, Transform
arrlinear_2 = LinearArray(Geometry=move_4.Geometry, Direction=Z_5, Count=number_slider_3)  # -> Geometry, Transform
panel_5 = Panel(wires_2)
pipe = Pipe(Curve=[arrlinear.Geometry, arrlinear_2.Geometry], Radius=25, Caps=0)
midpt = CurveMiddle(Curve=wires)
col = Colour(RGB(87, 25, 255))
tag = TextTag3D(Location=midpt, Text="箍筋", Size=number_slider_4, Justification=7)
preview = CustomPreview(Geometry=pipe, Material=col)
midpt_2 = CurveMiddle(Curve=wires_2)
tag_2 = TextTag3D(Location=midpt_2, Text="主筋", Size=number_slider_4, Justification=7)

len = Length(Curve=wires_2)
division = Division(A=len, B=Slider(160, range=0..1000))
panel_6 = Panel(division)

加密区间距_2 = Slider(100, range=-1000..1000)
number_slider_5 = Slider(16, range=0..50)
Z_8 = UnitZ(Factor=expr("x", 加密区间距_2))
Z_9 = UnitZ(Factor=expr("-x", 加密区间距_2))
project_3 = Project(Geometry=箍筋, Plane=move_3.Geometry)  # -> Geometry, Transform
arrlinear_3 = LinearArray(Geometry=箍筋, Direction=Z_9, Count=number_slider_5)  # -> Geometry, Transform
arrlinear_4 = LinearArray(Geometry=project_3.Geometry, Direction=Z_8, Count=number_slider_5)  # -> Geometry, Transform
number_slider_6 = Slider(8, range=0..10)
split = SplitList(List=reverse(arrlinear_4.Geometry), Index=number_slider_6)  # -> ListA, ListB
split_2 = SplitList(List=arrlinear_4.Geometry, Index=number_slider_6)  # -> ListA, ListB
panel_7 = Panel(split_2.ListA)
offset_6 = OffsetCurve(Curve=split_2.ListA, Distance=Slider(19, range=0..100), Plane=PlaneXY(0, 0, 0), Corners=1)
panel_8 = Panel(split_2.ListB)

# ---- group: 获得中间距离
lng = ListLength(List=arrlinear_3.Geometry)  # -> expr("x-1", Length)
item_5 = ListItem(List=arrlinear_3.Geometry, Index=lng, Wrap=True)
item_6 = ListItem(List=arrlinear_4.Geometry, Index=lng, Wrap=True)
pl_offset = PlaneOffset(BasePlane=item_5, Offset=1)
pl_offset_2 = PlaneOffset(BasePlane=item_6, Offset=1)

# ----
dist = Distance(PointA=pl_offset, PointB=pl_offset_2)
division_2 = Division(A=dist, B=150)
panel_9 = Panel(division_2)

pcx = CurvePlane(Curve=ln, Plane=pl_offset)  # -> Points, ParamsC, ParamsP
pcx_2 = CurvePlane(Curve=ln, Plane=pl_offset_2)  # -> Points, ParamsC, ParamsP
ln_2 = Line(StartPoint=pcx.Points, EndPoint=pcx_2.Points)

divide = DivideCurve(Curve=ln_2, Count=division_2, Kinks=False)  # -> Points, Tangents, Parameters
Z_10 = UnitZ(Factor=1)
pl = PlaneNormal(Origin=divide.Points, ZAxis=Z_10)
sec_2 = BrepPlane(Brep=extr, Plane=pl)  # -> Curves, Points
offset_7 = OffsetCurve(Curve=sec_2.Curves, Distance=expr("-x", 保护层厚度), Plane=PlaneXY(0, 0, 0), Corners=1)

# ---- group: 检测中间距离
item_7 = ListItem(List=divide.Points, Index=1, Wrap=True)
item_8 = ListItem(List=divide.Points, Index=0, Wrap=True)
dist_2 = Distance(PointA=item_8, PointB=item_7)
结果_中间箍筋距离 = Panel(dist_2)

# ---- group: 主筋
divide_2 = DivideCurve(Curve=wires_2, Count=division, Kinks=False)  # -> Points, Tangents, Parameters
project_4 = Project(Geometry=divide_2.Points, Plane=debox.Plane)  # -> Geometry, Transform
ln_3 = Line(StartPoint=divide_2.Points, EndPoint=project_4.Geometry)
ext = ExtendCurve(Curve=ln_3, Type=0, Start=Slider(400, range=0..1000), End=Slider(-400, range=-4000..4000.001))

# ----
套筒半径 = Slider(47.5, range=0..100)
套筒高度 = Slider(800, range=0..1000)
cir = Circle(Plane=project_4.Geometry, Radius=套筒半径)
Z_11 = UnitZ(Factor=套筒高度)
extr_2 = Extrude(Base=cir, Direction=Z_11)
col_2 = Colour(RGB(6, 0, 255))
preview_2 = CustomPreview(Geometry=extr_2, Material=col_2)

# ---- group: 主筋
cull_i = CullIndex(List=ext, Indices=0, Wrap=True)

# ----
pipe_2 = Pipe(Curve=cull_i, Radius=Slider(25, range=0..100), Caps=1)
col_3 = Colour(RGB(217, 56, 255))
preview_3 = CustomPreview(Geometry=pipe_2, Material=col_3)

panel_10 = Panel(cull_i)

箍筋倒角 = Slider(78, range=0..100)
fillet_2 = Fillet(Curve=[arrlinear_3.Geometry, offset_7, split.ListA, offset_6], Radius=箍筋倒角)

number_slider_7 = Slider(8, range=0..20)
expression = Expression(x=number_slider_7, Expression="x*½")
expression_2 = Expression(x=number_slider_7, Expression="x*⅓")
panel_11 = Panel(expression_2)
panel_12 = Panel(expression)

箍筋半径 = Slider(24, range=0..100)
pipe_3 = Pipe(Curve=fillet_2, Radius=箍筋半径, Caps=0)
col_4 = Colour(RGB(29, 237, 255))
preview_4 = CustomPreview(Geometry=pipe_3, Material=col_4)

c_script = CSharpScript(x=number_slider_7)  # -> A; inputs x: Double
# ---------- c_script: C# ----------
    if(x % 2 == 0)
    {
      A = x / 3;
    }else if (x % 2 == 1)
    {
      A = (x / 3) + 1;
    }
# ---------- end c_script ----------
expression_3 = Expression(x=number_slider_7, Expression="x*¼")
expression_4 = Expression(x=number_slider_7, Expression="x*¾")
panel_13 = Panel(c_script)
panel_14 = Panel(expression_4)
panel_15 = Panel(expression_3)
