# Grasshopper definition rebar_geometrical3.gh (Grasshopper 1.0.7)

recgrid = Rectangular(Plane=PlaneXY(0, 0, 0), SizeX=1, SizeY=2, ExtentX=1, ExtentY=1)  # -> Cells, Points; disabled
X = UnitX(Factor=Slider(8576, range=0..10000))
move = Move(Geometry=recgrid.Cells, Motion=X)  # -> Geometry, Transform

debrep = DeconstructBrep(Brep=move.Geometry)  # -> Faces, Edges, Vertices
pline = PolyLine(Vertices=debrep.Vertices, Closed=True)
offsets = OffsetOnSrf(Curve=debrep.Edges, Distance=100, Surface=debrep.Faces)  # -> flatten(Curve)
crv = Curve(pline)
end = EndPoints(Curve=crv)  # -> Start, End
cir = Circle(Plane=end.Start, Radius=100)
rdiff = RegionDifference(CurvesA=pline, CurvesB=cir)
number_slider = Slider(134, range=0..2000)
xy = XYPlane(Origin=end.Start)
X_2 = UnitX(Factor=1)
line = LineSDL(Start=end.Start, Direction=X_2, Length=Slider(287, range=0..2000))
rotate = Rotate(Geometry=line, Angle=Slider(20, range=0..1000), Plane=xy)  # -> Geometry, Transform
join = JoinCurves(Curves=rotate.Geometry, Preserve=False)
fillet = Fillet(Curve=join, Radius=Slider(380, range=0..2000))

number_slider_2 = Slider(0, range=0..10000)
number_slider_3 = Slider(1872, range=0..10000)
X_3 = UnitX(Factor=1)
Y = UnitY(Factor=1)
cluster = Cluster_3(D_2=X_3, L_2=number_slider_2, D=X_3, L=number_slider_2)
cluster_2 = Cluster_3(D_2=Y, L_2=number_slider_3, D=Y, L=number_slider_3)
pl = PlaneNormal(Origin=Point(0, 0, 0), ZAxis=cluster)
swp1 = Sweep1(Rail=cluster, Sections=cluster_2, Miter=1)
mirror = Mirror(Geometry=swp1, Plane=pl)  # -> Geometry, Transform
join_2 = BrepJoin(Breps=[swp1, mirror.Geometry])  # -> Breps, Closed
debrep_2 = DeconstructBrep(Brep=join_2.Breps)  # -> Faces, Edges, Vertices
item = ListItem(List=debrep_2.Vertices, Index=[1, 2, 5, 4], Wrap=True)
pline_2 = PolyLine(Vertices=flatten(item), Closed=True)
Z = UnitZ(Factor=Slider(10000, range=0..10000))
extr = Extrude(Base=pline_2, Direction=Z)
panel = Panel(pline_2)
panel_2 = Panel(item)

pt = Point(<point referenced from the Rhino model>)
xy_2 = XYPlane(Origin=pt)
recgrid_2 = Rectangular(Plane=xy_2, SizeX=Slider(8000, range=0..10000), SizeY=Slider(9678, range=0..10000), ExtentX=1, ExtentY=1)  # -> Cells, Points
Z_2 = UnitZ(Factor=Slider(2200, range=0..10000))
pl_offset = PlaneOffset(BasePlane=xy_2, Offset=Z_2)
boxrec = BoxRectangle(Rectangle=recgrid_2.Cells, Height=Z_2)
debrep_3 = DeconstructBrep(Brep=boxrec)  # -> Faces, Edges, Vertices
item_2 = ListItem(List=debrep_3.Edges, Index=[4, 5, 6, 7], Wrap=True)

number_slider_4 = Slider(-750, range=-10000..10000)
number_slider_5 = Slider(-3789, range=-10000..10000)
number_slider_6 = Slider(-13250, range=-30000..30000)
pt_2 = Point([<point referenced from the Rhino model> x2])
pdecon = Deconstruct(Point=pt_2)  # -> XComponent, YComponent, ZComponent
pt_3 = ConstructPoint(XCoordinate=pdecon.XComponent, YCoordinate=pdecon.YComponent, ZCoordinate=pdecon.ZComponent)

offset = OffsetCurve(Curve=item_2, Distance=Slider(100, range=0..1000), Plane=PlaneXY(0, 0, 0), Corners=1)  # -> flatten(Curve)

# ----
# 这里是控制整个参数
套筒箍筋半径 = Slider(17, range=0..100)
保护层厚度 = Slider(-50, range=-300..300)
主筋半径 = Slider(30, range=0..100)
箍筋半径 = Slider(15, range=0..100)
箍筋倒角 = Slider(60, range=0..100)

Z_3 = UnitZ(Factor=expr("-x", Slider(100, range=0..100)))
move_2 = Move(Geometry=offset, Motion=Z_3)  # -> Geometry, Transform

xy_3 = XYPlane(Origin=pt_3)
panel_3 = Panel(xy_3)
recgrid_3 = Rectangular(Plane=xy_3, SizeX=Slider(1500, range=0..10000), SizeY=Slider(1500, range=0..10000), ExtentX=1, ExtentY=1)  # -> Cells, Points
Z_4 = UnitZ(Factor=Slider(9000, range=0..50000))
extr_2 = Extrude(Base=recgrid_3.Cells, Direction=Z_4)

item_3 = ListItem(List=move_2.Geometry, Index=4, Wrap=True)
item_4 = ListItem(List=move_2.Geometry, Index=5, Wrap=True)
item_5 = ListItem(List=move_2.Geometry, Index=6, Wrap=True)
item_6 = ListItem(List=move_2.Geometry, Index=7, Wrap=True)

ccx = CurveCurve(CurveA=graft(item_3), CurveB=item_4)  # -> Points, ParamsA, ParamsB
ccx_2 = CurveCurve(CurveA=graft(item_4), CurveB=item_5)  # -> Points, ParamsA, ParamsB
ccx_3 = CurveCurve(CurveA=graft(item_5), CurveB=item_6)  # -> Points, ParamsA, ParamsB
ccx_4 = CurveCurve(CurveA=graft(item_6), CurveB=item_3)  # -> Points, ParamsA, ParamsB

debrep_4 = DeconstructBrep(Brep=extr_2)  # -> Faces, Edges, Vertices

ln = Line(StartPoint=ccx.Points, EndPoint=ccx_2.Points)
ln_2 = Line(StartPoint=ccx_3.Points, EndPoint=ccx_2.Points)
ln_3 = Line(StartPoint=ccx_4.Points, EndPoint=ccx_3.Points)
ln_4 = Line(StartPoint=ccx_4.Points, EndPoint=ccx.Points)

unit_z = UnitZ(Factor=1)

unit_z_2 = UnitZ(Factor=Slider(2000, range=0..10000))
move_3 = Move(Geometry=[ccx.Points, ccx_2.Points, ccx_3.Points, ccx_4.Points], Motion=unit_z)  # -> Geometry, Transform
move_4 = Move(Geometry=[ccx.Points, ccx_2.Points, ccx_3.Points, ccx_4.Points], Motion=expr("-x", unit_z_2))  # -> Geometry, Transform
move_5 = Move(Geometry=[ln, ln_2, ln_3, ln_4], Motion=expr("-x", unit_z_2))  # -> Geometry, Transform

shift_paths = ShiftPaths(Data=move_5.Geometry, Offset=0)
list_item = ListItem(List=shift_paths, Index=[0, 2], Wrap=True)
panel_4 = Panel(list_item)

# ---- group: 中间部分小箍筋
number_slider_7 = Slider(540, range=0..1000)
number_slider_8 = Slider(50, range=0..1000)
int = Integer(1)
int_2 = Integer(3)
int_3 = Integer(2)
int_4 = Integer(4)
item_7 = ListItem(List=debrep_4.Faces, Index=int, Wrap=True)
item_8 = ListItem(List=debrep_4.Faces, Index=int_2, Wrap=True)
item_9 = ListItem(List=debrep_4.Faces, Index=int_3, Wrap=True)
item_10 = ListItem(List=debrep_4.Faces, Index=int_4, Wrap=True)
offset_2 = OffsetSurface(Surface=item_7, Distance=number_slider_7, Retrim=True)
offset_3 = OffsetSurface(Surface=item_8, Distance=number_slider_7, Retrim=True)
offset_4 = OffsetSurface(Surface=item_9, Distance=number_slider_8, Retrim=True)
offset_5 = OffsetSurface(Surface=item_10, Distance=number_slider_8, Retrim=True)
bbx = BrepBrep(BrepA=graft(offset_2), BrepB=offset_4)  # -> Curves, Points
bbx_2 = BrepBrep(BrepA=graft(offset_3), BrepB=offset_4)  # -> Curves, Points
bbx_3 = BrepBrep(BrepA=graft(offset_3), BrepB=offset_5)  # -> Curves, Points
bbx_4 = BrepBrep(BrepA=graft(offset_2), BrepB=offset_5)  # -> Curves, Points
plx = LinePlane(Line=[bbx.Curves, bbx_2.Curves, bbx_3.Curves, bbx_4.Curves], Plane=xy_3)  # -> Point, ParamL, ParamP
pline_3 = PolyLine(Vertices=plx.Point, Closed=True)
int_5 = Integer(50)
fillet_2 = Fillet(Curve=pline_3, Radius=Slider(40, range=0..100))
Z_5 = UnitZ(Factor=int_5)
move_6 = Move(Geometry=fillet_2, Motion=Z_5)  # -> Geometry, Transform

# ----
number_slider_9 = Slider(50, range=0..1000)
number_slider_10 = Slider(540, range=0..1000)
int_6 = Integer(1)
int_7 = Integer(2)
int_8 = Integer(4)
int_9 = Integer(3)
item_11 = ListItem(List=debrep_4.Faces, Index=int_6, Wrap=True)
item_12 = ListItem(List=debrep_4.Faces, Index=int_9, Wrap=True)
item_13 = ListItem(List=debrep_4.Faces, Index=int_7, Wrap=True)
item_14 = ListItem(List=debrep_4.Faces, Index=int_8, Wrap=True)
offset_6 = OffsetSurface(Surface=item_11, Distance=number_slider_9, Retrim=True)
offset_7 = OffsetSurface(Surface=item_12, Distance=number_slider_9, Retrim=True)
offset_8 = OffsetSurface(Surface=item_13, Distance=number_slider_10, Retrim=True)
offset_9 = OffsetSurface(Surface=item_14, Distance=number_slider_10, Retrim=True)
bbx_5 = BrepBrep(BrepA=graft(offset_6), BrepB=offset_8)  # -> Curves, Points
bbx_6 = BrepBrep(BrepA=graft(offset_7), BrepB=offset_8)  # -> Curves, Points
bbx_7 = BrepBrep(BrepA=graft(offset_7), BrepB=offset_9)  # -> Curves, Points
bbx_8 = BrepBrep(BrepA=graft(offset_6), BrepB=offset_9)  # -> Curves, Points
plx_2 = LinePlane(Line=[bbx_5.Curves, bbx_6.Curves, bbx_7.Curves, bbx_8.Curves], Plane=xy_3)  # -> Point, ParamL, ParamP
pline_4 = PolyLine(Vertices=plx_2.Point, Closed=True)
int_10 = Integer(50)
fillet_3 = Fillet(Curve=pline_4, Radius=Slider(40, range=0..100))
Z_6 = UnitZ(Factor=int_10)
move_7 = Move(Geometry=fillet_3, Motion=Z_6)  # -> Geometry, Transform

line_2 = Line(StartPoint=move_3.Geometry, EndPoint=move_4.Geometry)
panel_5 = Panel(debrep_4.Edges)
list_item_2 = ListItem(List=move_5.Geometry, Index=1, Wrap=True)

list_item_3 = ListItem(List=move_5.Geometry, Index=3, Wrap=True)
list_item_4 = ListItem(List=move_5.Geometry, Index=1, Wrap=True)

list_item_5 = ListItem(List=move_5.Geometry, Index=3, Wrap=True)

line_3 = Line(list_item)
len = Length(Curve=line_3)
division = Division(A=len, B=Slider(150, range=0..1000))
divide = DivideCurve(Curve=line_3, Count=division, Kinks=False)  # -> Points, Tangents, Parameters

line_4 = Line([ln, ln_3])
len_2 = Length(Curve=line_4)
division_2 = Division(A=len_2, B=Slider(150, range=0..1000))
divide_2 = DivideCurve(Curve=line_4, Count=division_2, Kinks=False)  # -> Points, Tangents, Parameters

panel_6 = Panel(line_4)

line_5 = Line([list_item_2, ln_2])
len_3 = Length(Curve=line_5)
division_3 = Division(A=len_3, B=Slider(150, range=0..1000))
divide_3 = DivideCurve(Curve=line_5, Count=division_3, Kinks=False)  # -> Points, Tangents, Parameters

line_6 = Line([ln_2, ln_4])
len_4 = Length(Curve=line_6)
division_4 = Division(A=len_4, B=Slider(150, range=0..1000))
divide_4 = DivideCurve(Curve=line_6, Count=division_4, Kinks=False)  # -> Points, Tangents, Parameters

line_7 = Line([list_item_3, list_item_4])
len_5 = Length(Curve=line_7)
division_5 = Division(A=len_5, B=Slider(150, range=0..1000))
divide_5 = DivideCurve(Curve=line_7, Count=division_5, Kinks=False)  # -> Points, Tangents, Parameters

line_8 = Line([list_item_5, ln_4])
len_6 = Length(Curve=line_8)
division_6 = Division(A=len_6, B=Slider(150, range=0..1000))
divide_6 = DivideCurve(Curve=line_8, Count=division_6, Kinks=False)  # -> Points, Tangents, Parameters

vb = VBScript()  # -> A
# ---------- vb: C# ----------
    A = System.Math.Abs(x) + System.Math.Abs(y)
# ---------- end vb ----------
# 这里是立柱的所有钢筋
number_slider_11 = Slider(68, range=0..100)

shift_paths_2 = ShiftPaths(Data=divide_2.Points, Offset=3)
shift_paths_3 = ShiftPaths(Data=divide.Points, Offset=3)
explode_tree = ExplodeTree(Data=shift_paths_2)  # -> Branch0, Branch1
explode_tree_2 = ExplodeTree(Data=shift_paths_3)  # -> Branch0, Branch1
line_9 = Line(StartPoint=explode_tree_2.Branch0, EndPoint=explode_tree_2.Branch1)
line_10 = Line(StartPoint=explode_tree.Branch0, EndPoint=explode_tree.Branch1)
line_11 = Line(StartPoint=explode_tree_2.Branch0, EndPoint=explode_tree.Branch0)
line_12 = Line(StartPoint=explode_tree.Branch1, EndPoint=explode_tree_2.Branch1)

shift_paths_4 = ShiftPaths(Data=divide_5.Points, Offset=3)
explode_tree_3 = ExplodeTree(Data=shift_paths_4)  # -> Branch0, Branch1
line_13 = Line(StartPoint=explode_tree_3.Branch0, EndPoint=explode_tree_3.Branch1)

shift_paths_5 = ShiftPaths(Data=divide_3.Points, Offset=3)
explode_tree_4 = ExplodeTree(Data=shift_paths_5)  # -> Branch0, Branch1
line_14 = Line(StartPoint=explode_tree_4.Branch0, EndPoint=explode_tree_4.Branch1)

shift_paths_6 = ShiftPaths(Data=divide_6.Points, Offset=3)
explode_tree_5 = ExplodeTree(Data=shift_paths_6)  # -> Branch0, Branch1
line_15 = Line(StartPoint=explode_tree_5.Branch0, EndPoint=explode_tree_5.Branch1)

shift_paths_7 = ShiftPaths(Data=divide_4.Points, Offset=3)
explode_tree_6 = ExplodeTree(Data=shift_paths_7)  # -> Branch0, Branch1
line_16 = Line(StartPoint=explode_tree_6.Branch0, EndPoint=explode_tree_6.Branch1)

panel_7 = Panel(line_2)
shift_paths_8 = ShiftPaths(Data=line_2, Offset=0)

line_17 = Line(shift_paths_8)
len_7 = Length(Curve=line_17)
division_7 = Division(A=len_7, B=Slider(150, range=0..1000))
divide_7 = DivideCurve(Curve=line_17, Count=division_7, Kinks=False)  # -> Points, Tangents, Parameters

shift_paths_9 = ShiftPaths(Data=divide_7.Points, Offset=2)
Z_7 = UnitZ(Factor=Slider(60, range=0..100))
explode_tree_7 = ExplodeTree(Data=shift_paths_9)  # -> Branch0, Branch1, Branch2, Branch3
line_18 = Line(StartPoint=explode_tree_7.Branch0, EndPoint=explode_tree_7.Branch1)
line_19 = Line(StartPoint=explode_tree_7.Branch1, EndPoint=explode_tree_7.Branch2)
line_20 = Line(StartPoint=explode_tree_7.Branch2, EndPoint=explode_tree_7.Branch3)
line_21 = Line(StartPoint=explode_tree_7.Branch0, EndPoint=explode_tree_7.Branch3)

number_slider_12 = Slider(8, range=0..20)
cluster_3 = Cluster(x_2=number_slider_12, x_3=number_slider_12, x_4=number_slider_12, x=number_slider_12, x_5=number_slider_12)  # -> R_2, R_3, R_4, R, A
panel_8 = Panel(cluster_3.R_3)
panel_9 = Panel(cluster_3.R_2)
panel_10 = Panel(cluster_3.R_4)
panel_11 = Panel(cluster_3.A)
panel_12 = Panel(cluster_3.R)

# ----
# 顶部钢筋构造
surface = Surface([<surface referenced from the Rhino model> x4])
brep = Brep([<brep referenced from the Rhino model> x4])
brep_join = BrepJoin(Breps=surface)  # -> Breps, Closed
deconstruct_brep = DeconstructBrep(Brep=brep)  # -> Faces, Edges, Vertices
list_item_6 = ListItem(List=deconstruct_brep.Faces, Index=[70, 71], Wrap=True)
brep_2 = Brep(list_item_6)
brep_edges = BrepEdges(Brep=brep_2)  # -> Naked, Interior, NonManifold
list_item_7 = ListItem(List=flatten(brep_edges.Naked), Index=Slider(17, range=0..100), Wrap=True)
number_slider_13 = Slider(-100, range=-1000..10000)
curve = Curve(list_item_7)
extend_curve = ExtendCurve(Curve=curve, Type=0, Start=number_slider_13, End=number_slider_13)
list_item_8 = ListItem(List=extend_curve, Index=1, Wrap=True)
len_8 = Length(Curve=list_item_8)
division_8 = Division(A=len_8, B=Slider(150, range=0..1000))
divide_curve = DivideCurve(Curve=list_item_8, Count=division_8, Kinks=False)  # -> Points, Tangents, Parameters
perp_frame = PerpFrame(Curve=list_item_8, Parameter=divide_curve.Parameters)
plane = Plane(perp_frame)
mesh_plane = MeshPlane(Mesh=brep_join.Breps, Plane=plane)  # -> flatten(Curves)
panel_13 = Panel(mesh_plane)
unit_z_3 = UnitZ(Factor=Slider(100, range=0..100))
move_8 = Move(Geometry=mesh_plane, Motion=unit_z_3)  # -> Geometry, Transform
number_slider_14 = Slider(-55, range=-1000..1000)
extend_curve_2 = ExtendCurve(Curve=move_8.Geometry, Type=0, Start=number_slider_14, End=number_slider_14)
pipe = Pipe(Curve=extend_curve_2, Radius=Slider(25, range=0..100), Caps=1)

xz_plane = XZPlane(Origin=Point(0, 0, 0))
unit_y = UnitY(Factor=Slider(150, range=0..1000))

顶部曲面 = Surface([<surface referenced from the Rhino model> x2])
brep_3 = Brep([<brep referenced from the Rhino model> x2])
deconstruct_brep_2 = DeconstructBrep(Brep=brep_3)  # -> Faces, Edges, Vertices
list_item_9 = ListItem(List=deconstruct_brep_2.Faces, Index=[70, 71], Wrap=True)
brep_4 = Brep(list_item_9)
brep_edges_2 = BrepEdges(Brep=brep_4)  # -> Naked, Interior, NonManifold
brep_join_2 = BrepJoin(Breps=顶部曲面)  # -> Breps, Closed
list_item_10 = ListItem(List=flatten(brep_edges_2.Naked), Index=Slider(2, range=0..100), Wrap=True)
number_slider_15 = Slider(-100, range=-1000..10000)
curve_2 = Curve(list_item_10)
extend_curve_3 = ExtendCurve(Curve=curve_2, Type=0, Start=number_slider_15, End=number_slider_15)
# 顶部钢筋构造
list_item_11 = ListItem(List=extend_curve_3, Index=1, Wrap=True)
len_9 = Length(Curve=list_item_11)
division_9 = Division(A=len_9, B=Slider(150, range=0..1000))
divide_curve_2 = DivideCurve(Curve=list_item_11, Count=division_9, Kinks=False)  # -> Points, Tangents, Parameters
perp_frame_2 = PerpFrame(Curve=list_item_11, Parameter=divide_curve_2.Parameters)
plane_2 = Plane(perp_frame_2)
mesh_plane_2 = MeshPlane(Mesh=brep_join_2.Breps, Plane=plane_2)  # -> flatten(Curves)
panel_14 = Panel(mesh_plane_2)
unit_z_4 = UnitZ(Factor=expr("-X", Slider(100, range=0..100)))
move_9 = Move(Geometry=mesh_plane_2, Motion=unit_z_4)  # -> Geometry, Transform
number_slider_16 = Slider(398, range=-1000..1000)
extend_curve_4 = ExtendCurve(Curve=move_9.Geometry, Type=0, Start=number_slider_16, End=number_slider_16)
pipe_2 = Pipe(Curve=extend_curve_4, Radius=Slider(25, range=0..100), Caps=1)

surface_2 = Surface([<surface referenced from the Rhino model> x2])
unit_z_5 = UnitZ(Factor=Slider(200, range=0..1000))
surface_3 = Surface(顶部曲面)
move_10 = Move(Geometry=surface_3, Motion=expr("-x", unit_z_5))  # -> Geometry, Transform
deconstruct_brep_3 = DeconstructBrep(Brep=surface_2)  # -> Faces, flatten(Edges), Vertices
list_item_12 = ListItem(List=move_10.Geometry, Index=0, Wrap=True)
number_slider_17 = Slider(561, range=0..1000)
face_normals = FaceNormals(Mesh=list_item_12)  # -> Centers, Normals
list_item_13 = ListItem(List=deconstruct_brep_3.Edges, Index=Slider(0, range=0..10), Wrap=True)
# 侧面钢筋构造
adjust_plane = AdjustPlane(Plane=face_normals.Centers, Normal=face_normals.Normals)
extend_curve_5 = ExtendCurve(Curve=list_item_13, Type=0, Start=number_slider_17, End=number_slider_17)
line_sdl = LineSDL(Start=face_normals.Centers, Direction=face_normals.Normals, Length=expr("-x", Slider(2550, range=0..10000)))
divide_length = DivideLength(Curve=line_sdl, Length=Slider(150, range=0..300))  # -> Points, Tangents, Parameters
perp_frame_3 = PerpFrame(Curve=line_sdl, Parameter=divide_length.Parameters)
mesh_plane_3 = MeshPlane(Mesh=graft(surface_2), Plane=perp_frame_3)  # -> flatten(Curves)
offset_curve = OffsetCurve(Curve=mesh_plane_3, Distance=expr("-x", Slider(109, range=0..200)), Plane=perp_frame_3, Corners=1)  # -> flatten(Curve)
pipe_3 = Pipe(Curve=offset_curve, Radius=Slider(25, range=0..100), Caps=1)

linear_array = LinearArray(Geometry=xz_plane, Direction=unit_y, Count=Slider(83, range=0..100))  # -> Geometry, Transform
surface_4 = Surface([<surface referenced from the Rhino model> x10])
surface_5 = Surface([顶部曲面, surface, surface_4])
mirror_2 = Mirror(Geometry=linear_array.Geometry, Plane=xz_plane)  # -> flatten(Geometry), Transform
panel_15 = Panel(surface)
mesh_join = MeshJoin(Meshes=surface_5)
plane_3 = Plane(flatten([mirror_2.Geometry, linear_array.Geometry]))
# 新版本的盖梁
panel_16 = Panel(mirror_2.Geometry)
panel_17 = Panel(plane_3)
mesh_plane_4 = MeshPlane(Mesh=mesh_join, Plane=plane_3)
boundary_surfaces = BoundarySurfaces(Edges=mesh_plane_4)
colour = Colour(RGB(159, 131, 255))
custom_preview = CustomPreview(Geometry=boundary_surfaces, Material=colour)
deconstruct_brep_4 = DeconstructBrep(Brep=boundary_surfaces)  # -> Faces, Edges, Vertices
list_length = ListLength(List=offset_curve)  # -> flatten(Length)
split_list = SplitList(List=offset_curve, Index=list_length)  # -> ListA, ListB
panel_18 = Panel(list_length)
offset_on_srf = OffsetOnSrf(Curve=deconstruct_brep_4.Edges, Distance=Slider(100, range=0..1000), Surface=deconstruct_brep_4.Faces)
boundary_surfaces_2 = BoundarySurfaces(Edges=offset_on_srf)
custom_preview_2 = CustomPreview(Geometry=pipe_3, Material=ColourSwatch(SwatchColor=RGB(164, 54, 255)))
number_slider_18 = Slider(2200, range=0..10000)
pt_4 = Point(<point referenced from the Rhino model>)  # disabled
xy_4 = XYPlane(Origin=pt_4)
recgrid_4 = Rectangular(Plane=xy_4, SizeX=Slider(8000, range=0..10000), SizeY=Slider(9678, range=0..10000), ExtentX=1, ExtentY=1)  # -> Cells, Points
Z_8 = UnitZ(Factor=number_slider_18)
pl_offset_2 = PlaneOffset(BasePlane=xy_4, Offset=Z_8)
boxrec_2 = BoxRectangle(Rectangle=recgrid_4.Cells, Height=Z_8)
debrep_5 = DeconstructBrep(Brep=boxrec_2)  # -> Faces, Edges, Vertices
item_15 = ListItem(List=debrep_5.Edges, Index=[4, 5, 6, 7], Wrap=True)
evaluate = Evaluate(Expression="x-y", x=number_slider_18, y=Slider(150, range=0..1000))
offset_10 = OffsetCurve(Curve=item_15, Distance=Slider(100, range=0..1000), Plane=PlaneXY(0, 0, 0), Corners=1)  # -> flatten(Curve)

number_slider_19 = Slider(100, range=0..100)
Z_9 = UnitZ(Factor=expr("-x", number_slider_19))
move_11 = Move(Geometry=offset_10, Motion=Z_9)  # -> Geometry, Transform
item_16 = ListItem(List=move_11.Geometry, Index=4, Wrap=True)
item_17 = ListItem(List=move_11.Geometry, Index=5, Wrap=True)
item_18 = ListItem(List=move_11.Geometry, Index=6, Wrap=True)
item_19 = ListItem(List=move_11.Geometry, Index=7, Wrap=True)
ccx_5 = CurveCurve(CurveA=graft(item_16), CurveB=item_17)  # -> Points, ParamsA, ParamsB
ccx_6 = CurveCurve(CurveA=graft(item_17), CurveB=item_18)  # -> Points, ParamsA, ParamsB
ccx_7 = CurveCurve(CurveA=graft(item_18), CurveB=item_19)  # -> Points, ParamsA, ParamsB
ccx_8 = CurveCurve(CurveA=graft(item_19), CurveB=item_16)  # -> Points, ParamsA, ParamsB
ln_5 = Line(StartPoint=ccx_5.Points, EndPoint=ccx_6.Points)
ln_6 = Line(StartPoint=ccx_8.Points, EndPoint=ccx_7.Points)
len_10 = Length(Curve=[ln_5, ln_6])
division_10 = Division(A=len_10, B=Slider(150, range=0..1000))
divide_8 = DivideCurve(Curve=ln_6, Count=division_10, Kinks=False)  # -> Points, Tangents, Parameters
divide_9 = DivideCurve(Curve=ln_5, Count=division_10, Kinks=False)  # -> Points, Tangents, Parameters
Z_10 = UnitZ(Factor=1)
line_22 = LineSDL(Start=[divide_9.Points, divide_8.Points], Direction=Z_10, Length=expr("-x", Slider(160, range=0..1000)))
ln_7 = Line(StartPoint=divide_9.Points, EndPoint=divide_8.Points)
join_3 = JoinCurves(Curves=[ln_7, line_22], Preserve=False)
number_slider_20 = Slider(15, range=0..100)
fillet_4 = Fillet(Curve=join_3, Radius=25)
pipe_4 = Pipe(Curve=fillet_4, Radius=number_slider_20, Caps=1)

Z_11 = UnitZ(Factor=expr("-x", evaluate))
move_12 = Move(Geometry=offset_10, Motion=Z_11)  # -> Geometry, Transform
item_20 = ListItem(List=move_12.Geometry, Index=4, Wrap=True)
item_21 = ListItem(List=move_12.Geometry, Index=5, Wrap=True)
item_22 = ListItem(List=move_12.Geometry, Index=6, Wrap=True)
item_23 = ListItem(List=move_12.Geometry, Index=7, Wrap=True)
ccx_9 = CurveCurve(CurveA=graft(item_20), CurveB=item_21)  # -> Points, ParamsA, ParamsB
ccx_10 = CurveCurve(CurveA=graft(item_21), CurveB=item_22)  # -> Points, ParamsA, ParamsB
ccx_11 = CurveCurve(CurveA=graft(item_22), CurveB=item_23)  # -> Points, ParamsA, ParamsB
ccx_12 = CurveCurve(CurveA=graft(item_23), CurveB=item_20)  # -> Points, ParamsA, ParamsB
ln_8 = Line(StartPoint=ccx_9.Points, EndPoint=ccx_10.Points)
ln_9 = Line(StartPoint=ccx_12.Points, EndPoint=ccx_11.Points)
len_11 = Length(Curve=[ln_8, ln_9])
division_11 = Division(A=len_11, B=Slider(150, range=0..1000))
divide_10 = DivideCurve(Curve=ln_9, Count=division_11, Kinks=False)  # -> Points, Tangents, Parameters
divide_11 = DivideCurve(Curve=ln_8, Count=division_11, Kinks=False)  # -> Points, Tangents, Parameters
Z_12 = UnitZ(Factor=1)
ln_10 = Line(StartPoint=divide_11.Points, EndPoint=divide_10.Points)
line_23 = LineSDL(Start=[divide_11.Points, divide_10.Points], Direction=Z_12, Length=Slider(160, range=0..1000))
join_4 = JoinCurves(Curves=[ln_10, line_23], Preserve=False)
fillet_5 = Fillet(Curve=join_4, Radius=25)
pipe_5 = Pipe(Curve=fillet_5, Radius=Slider(15, range=0..100), Caps=1)

colour_2 = Colour(RGB(43, 255, 255))
custom_preview_3 = CustomPreview(Geometry=pipe, Material=colour_2)

vb_2 = VBScript(x=number_slider_19, y=number_slider_20)  # -> out, A
# ---------- vb_2: C# ----------
    A = x + (y * 2)
# ---------- end vb_2 ----------

Z_13 = UnitZ(Factor=Slider(2380, range=0..10000))

number_slider_21 = Slider(1848, range=0..10000)
Z_14 = UnitZ(Factor=1)

number_slider_22 = Slider(30, range=0..100)

line_24 = Line(StartPoint=ccx_12.Points, EndPoint=ccx_9.Points)
line_25 = Line(StartPoint=ccx_11.Points, EndPoint=ccx_10.Points)
len_12 = Length(Curve=line_24)
division_12 = Division(A=len_12, B=Slider(150, range=0..1000))
divide_12 = DivideCurve(Curve=line_24, Count=division_12, Kinks=False)  # -> Points, Tangents, Parameters
divide_13 = DivideCurve(Curve=line_25, Count=division_12, Kinks=False)  # -> Points, Tangents, Parameters
ln_11 = Line(StartPoint=divide_12.Points, EndPoint=divide_13.Points)
number_slider_23 = Slider(20, range=0..100)
flip_curve = FlipCurve(Curve=ln_11)  # -> Curve, Flag
evaluate_length = EvaluateLength(Curve=flip_curve.Curve, Length=number_slider_23, Normalized=False)  # -> Point, Tangent, Parameter
evaluate_length_2 = EvaluateLength(Curve=ln_11, Length=number_slider_23, Normalized=False)  # -> Point, Tangent, Parameter
Z_15 = UnitZ(Factor=1)
line_26 = Line(StartPoint=evaluate_length_2.Point, EndPoint=evaluate_length.Point)
line_27 = LineSDL(Start=[evaluate_length_2.Point, evaluate_length.Point], Direction=Z_15, Length=Slider(160, range=0..1000))
join_5 = JoinCurves(Curves=[line_26, line_27], Preserve=False)
unit_z_6 = UnitZ(Factor=Slider(30, range=0..100))
fillet_6 = Fillet(Curve=join_5, Radius=25)
move_13 = Move(Geometry=fillet_6, Motion=unit_z_6)  # -> Geometry, Transform
pipe_6 = Pipe(Curve=move_13.Geometry, Radius=Slider(15, range=0..100), Caps=1)
col = Colour(RGB(210, 169, 68))
preview = CustomPreview(Geometry=pipe_6, Material=col)

col_2 = Colour(RGB(111, 54, 255))
col_3 = Colour(RGB(192, 87, 255))
col_4 = Colour(RGB(180, 102, 255))
preview_2 = CustomPreview(Geometry=pipe_5, Material=col_2)
preview_3 = CustomPreview(Geometry=pipe_4, Material=col_4)

line_28 = Line(StartPoint=divide_8.Points, EndPoint=divide_10.Points)
number_slider_24 = Slider(160, range=0..1000)
end_points = EndPoints(Curve=line_28)  # -> Start, End
unit_x = UnitX(Factor=1)
line_sdl_2 = LineSDL(Start=end_points.End, Direction=unit_x, Length=number_slider_24)
line_sdl_3 = LineSDL(Start=end_points.Start, Direction=unit_x, Length=number_slider_24)
join_curves = JoinCurves(Curves=[line_sdl_3, line_28, line_sdl_2], Preserve=False)
fillet_7 = Fillet(Curve=join_curves, Radius=Slider(25, range=0..100))
unit_y_2 = UnitY(Factor=Slider(30, range=0..100))
move_14 = Move(Geometry=fillet_7, Motion=unit_y_2)  # -> Geometry, Transform
c_script = CSharpScript(List=move_14.Geometry)  # -> List; inputs List: list, FirstRemove: Boolean
# ---------- c_script: C# ----------
    for(int i = 0;i <= List.Count;i++)
    {
     
    }
# ---------- end c_script ----------
pipe_7 = Pipe(Curve=move_14.Geometry, Radius=Slider(15, range=0..100), Caps=1)
col_5 = Colour(RGB(114, 81, 255))
preview_4 = CustomPreview(Geometry=pipe_7, Material=col_5)

line_29 = Line(StartPoint=divide_9.Points, EndPoint=divide_11.Points)
number_slider_25 = Slider(160, range=0..1000)
end_points_2 = EndPoints(Curve=line_29)  # -> Start, End
unit_x_2 = UnitX(Factor=1)
line_sdl_4 = LineSDL(Start=end_points_2.End, Direction=expr("-x", unit_x_2), Length=number_slider_25)
line_sdl_5 = LineSDL(Start=end_points_2.Start, Direction=expr("-x", unit_x_2), Length=number_slider_25)
join_curves_2 = JoinCurves(Curves=[line_sdl_5, line_29, line_sdl_4], Preserve=False)
fillet_8 = Fillet(Curve=join_curves_2, Radius=Slider(25, range=0..100))
unit_y_3 = UnitY(Factor=Slider(30, range=0..100))
move_15 = Move(Geometry=fillet_8, Motion=unit_y_3)  # -> Geometry, Transform
c_script_2 = CSharpScript(List=move_15.Geometry)  # -> List; inputs List: list, FirstRemove: Boolean; same code as c_script
pipe_8 = Pipe(Curve=move_15.Geometry, Radius=Slider(15, range=0..100), Caps=1)
col_6 = Colour(RGB(114, 81, 255))
preview_5 = CustomPreview(Geometry=pipe_8, Material=col_6)

unit_z_7 = UnitZ(Factor=expr("-x", Slider(30, range=0..100)))

top_plane = PlaneOffset(BasePlane=xy_3, Offset=Z_4)
sec = BrepPlane(Brep=extr_2, Plane=top_plane)  # -> Curves, Points
panel_19 = Panel(top_plane)
主筋内偏移距离 = Slider(-46, range=-300..300)
pcen = PolygonCenter(Polyline=sec.Curves)  # -> CenterV, CenterE, CenterA
project = Project(Geometry=pcen.CenterV, Plane=xy_3)  # -> Geometry, Transform
ln_12 = Line(StartPoint=pcen.CenterV, EndPoint=project.Geometry)

int_11 = Integer(-50)
Z_16 = UnitZ(Factor=int_11)
move_16 = Move(Geometry=sec.Curves, Motion=Z_16)  # -> Geometry, Transform

int_12 = Integer(-50)
int_13 = Integer(50)
Z_17 = UnitZ(Factor=int_12)
Z_18 = UnitZ(Factor=int_13)
move_17 = Move(Geometry=top_plane, Motion=Z_17)  # -> Geometry, Transform
move_18 = Move(Geometry=xy_3, Motion=Z_18)  # -> Geometry, Transform

箍筋 = OffsetCurve(Curve=move_16.Geometry, Distance=保护层厚度, Plane=PlaneXY(0, 0, 0), Corners=1)
offset_11 = OffsetCurve(Curve=箍筋, Distance=主筋内偏移距离, Plane=PlaneXY(0, 0, 0), Corners=1)
wires = BrepWireframe(Brep=offset_11, Density=-1)

panel_20 = Panel(move_18.Geometry)

number_slider_26 = Slider(16, range=0..50)
加密区间距 = Slider(-100, range=-1000..1000)
Z_19 = UnitZ(Factor=expr("-x", 加密区间距))
Z_20 = UnitZ(Factor=expr("x", 加密区间距))
arrlinear = LinearArray(Geometry=move_18.Geometry, Direction=Z_19, Count=number_slider_26)  # -> Geometry, Transform
arrlinear_2 = LinearArray(Geometry=move_17.Geometry, Direction=Z_20, Count=number_slider_26)  # -> Geometry, Transform

midpt = CurveMiddle(Curve=wires)
panel_21 = Panel(wires)
tag = TextTag3D(Location=midpt, Text="主筋", Size=number_slider_11, Justification=7)

wires_2 = BrepWireframe(Brep=箍筋, Density=-1)
project_2 = Project(Geometry=graft(箍筋), Plane=arrlinear.Geometry)  # -> Geometry, Transform
project_3 = Project(Geometry=graft(箍筋), Plane=arrlinear_2.Geometry)  # -> Geometry, Transform
midpt_2 = CurveMiddle(Curve=wires_2)

箍筋上移动距离_箍筋直径 = Slider(30, range=-101..100)
project_4 = Project(Geometry=move_6.Geometry, Plane=arrlinear.Geometry)  # -> Geometry, Transform
顶部加密段 = Project(Geometry=move_6.Geometry, Plane=arrlinear_2.Geometry)  # -> Geometry, Transform
Z_21 = UnitZ(Factor=expr("-x", 箍筋上移动距离_箍筋直径))
Z_22 = UnitZ(Factor=箍筋上移动距离_箍筋直径)
move_19 = Move(Geometry=project_4.Geometry, Motion=Z_22)  # -> Geometry, Transform
顶部加密区投影 = Move(Geometry=顶部加密段.Geometry, Motion=Z_21)  # -> Geometry, Transform

project_5 = Project(Geometry=move_7.Geometry, Plane=arrlinear_2.Geometry)  # -> Geometry, Transform
Z_23 = UnitZ(Factor=expr("-(x*2)", 箍筋上移动距离_箍筋直径))
move_20 = Move(Geometry=project_5.Geometry, Motion=Z_23)  # -> Geometry, Transform

# ---- group: 获得中间距离
lng = ListLength(List=[arrlinear.Geometry, arrlinear_2.Geometry])  # -> expr("x-1", Length)
item_24 = ListItem(List=arrlinear.Geometry, Index=lng, Wrap=True)
item_25 = ListItem(List=arrlinear_2.Geometry, Index=lng, Wrap=True)
pl_offset_3 = PlaneOffset(BasePlane=item_24, Offset=1)
pl_offset_4 = PlaneOffset(BasePlane=item_25, Offset=1)

# ----
project_6 = Project(Geometry=move_7.Geometry, Plane=arrlinear.Geometry)  # -> Geometry, Transform

# ---- group: 设定颜色
col_7 = Colour(RGB(161, 153, 255))
pipe_9 = Pipe(Curve=顶部加密区投影.Geometry, Radius=箍筋半径, Caps=0)
preview_6 = CustomPreview(Geometry=pipe_9, Material=col_7)

# ----
move_21 = Move(Geometry=project_6.Geometry, Motion=Z_7)  # -> Geometry, Transform

len_13 = Length(Curve=wires)
division_13 = Division(A=len_13, B=Slider(160, range=0..1000))
panel_22 = Panel(division_13)

number_slider_27 = Slider(8, range=0..10)
number_slider_28 = Slider(15, range=0..100)
split = SplitList(List=reverse(move_19.Geometry), Index=number_slider_27)  # -> ListA, ListB
split_2 = SplitList(List=move_19.Geometry, Index=number_slider_27)  # -> ListA, ListB
crv_2 = Curve(split_2.ListA)
crv_3 = Curve(split.ListA)
offset_12 = OffsetCurve(Curve=crv_2, Distance=number_slider_28, Plane=PlaneXY(0, 0, 0), Corners=1)

pcx = CurvePlane(Curve=ln_12, Plane=pl_offset_3)  # -> Points, ParamsC, ParamsP
pcx_2 = CurvePlane(Curve=ln_12, Plane=pl_offset_4)  # -> Points, ParamsC, ParamsP
ln_13 = Line(StartPoint=pcx.Points, EndPoint=pcx_2.Points)

split_3 = SplitList(List=reverse(move_21.Geometry), Index=number_slider_27)  # -> ListA, ListB
split_4 = SplitList(List=move_21.Geometry, Index=number_slider_27)  # -> ListA, ListB
crv_4 = Curve(split_3.ListA)
crv_5 = Curve(split_4.ListA)
offset_13 = OffsetCurve(Curve=crv_5, Distance=number_slider_28, Plane=PlaneXY(0, 0, 0), Corners=1)
pipe_10 = Pipe(Curve=[offset_13, crv_4], Radius=箍筋半径, Caps=0)
col_8 = Colour(RGB(40, 210, 255))
preview_7 = CustomPreview(Geometry=pipe_10, Material=col_8)

panel_23 = Panel(project_3.Geometry)

箍筋倒角_2 = Slider(40, range=0..100)
fillet_9 = Fillet(Curve=project_3.Geometry, Radius=箍筋倒角_2)

tag_2 = TextTag3D(Location=midpt_2, Text="箍筋", Size=number_slider_11, Justification=7)

箍筋半径_2 = Slider(30, range=0..100)
pipe_11 = Pipe(Curve=fillet_9, Radius=箍筋半径, Caps=0)
col_9 = Colour(RGB(29, 237, 255))
preview_8 = CustomPreview(Geometry=pipe_11, Material=col_9)

panel_24 = Panel(split.ListA)

dist = Distance(PointA=pl_offset_3, PointB=pl_offset_4)
division_14 = Division(A=dist, B=150)
panel_25 = Panel(division_14)

panel_26 = Panel(fillet_9)

# ---- group: 主筋
divide_14 = DivideCurve(Curve=wires, Count=division_13, Kinks=False)  # -> Points, Tangents, Parameters
project_7 = Project(Geometry=divide_14.Points, Plane=xy_3)  # -> Geometry, Transform
ln_14 = Line(StartPoint=divide_14.Points, EndPoint=project_7.Geometry)
ext = ExtendCurve(Curve=ln_14, Type=0, Start=Slider(400, range=0..1000), End=Slider(-400, range=-4000..4000.001))

# ----
套筒半径 = Slider(47.5, range=0..100)
套筒高度 = Slider(800, range=0..1000)
cir_2 = Circle(Plane=project_7.Geometry, Radius=套筒半径)
Z_24 = UnitZ(Factor=套筒高度)
extr_3 = Extrude(Base=cir_2, Direction=Z_24)
col_10 = Colour(RGB(6, 0, 255))
preview_9 = CustomPreview(Geometry=extr_3, Material=col_10)

divide_15 = DivideCurve(Curve=ln_13, Count=division_14, Kinks=False)  # -> Points, Tangents, Parameters
Z_25 = UnitZ(Factor=1)
pl_2 = PlaneNormal(Origin=divide_15.Points, ZAxis=Z_25)
sec_2 = BrepPlane(Brep=extr_2, Plane=pl_2)  # -> Curves, Points
offset_14 = OffsetCurve(Curve=sec_2.Curves, Distance=expr("-x", 保护层厚度), Plane=PlaneXY(0, 0, 0), Corners=1)  # -> flatten(Curve)

project_8 = Project(Geometry=move_7.Geometry, Plane=pl_2)  # -> Geometry, Transform
cluster_4 = Cluster_2(L=project_8.Geometry)
Z_26 = UnitZ(Factor=Slider(-30, range=-101..200))
move_22 = Move(Geometry=cluster_4, Motion=Z_26)  # -> Geometry, Transform

col_11 = Colour(RGB(45, 249, 104))
pipe_12 = Pipe(Curve=move_22.Geometry, Radius=箍筋半径, Caps=0)
preview_10 = CustomPreview(Geometry=pipe_12, Material=col_11)

Z_27 = UnitZ(Factor=箍筋上移动距离_箍筋直径)
project_9 = Project(Geometry=move_6.Geometry, Plane=pl_2)  # -> Geometry, Transform
move_23 = Move(Geometry=project_9.Geometry, Motion=Z_27)  # -> Geometry, Transform

cluster_5 = Cluster_2(L=move_23.Geometry)

number_slider_29 = Slider(15, range=0..100)
pipe_13 = Pipe(Curve=[offset_12, move_20.Geometry, cluster_5, crv_3], Radius=箍筋半径, Caps=0)
col_12 = Colour(RGB(87, 25, 255))
preview_11 = CustomPreview(Geometry=pipe_13, Material=col_12)

pipe_14 = Pipe(Curve=cluster_5, Radius=箍筋半径, Caps=0)
col_13 = Colour(RGB(87, 151, 255))
preview_12 = CustomPreview(Geometry=pipe_14, Material=col_13)

number_slider_30 = Slider(8, range=0..10)
split_5 = SplitList(List=reverse(project_2.Geometry), Index=number_slider_30)  # -> ListA, ListB
split_6 = SplitList(List=project_2.Geometry, Index=number_slider_30)  # -> ListA, ListB
offset_15 = OffsetCurve(Curve=split_6.ListA, Distance=套筒箍筋半径, Plane=PlaneXY(0, 0, 0), Corners=1)

# ---- group: 检测中间距离
item_26 = ListItem(List=divide_15.Points, Index=0, Wrap=True)
item_27 = ListItem(List=divide_15.Points, Index=1, Wrap=True)
dist_2 = Distance(PointA=item_26, PointB=item_27)
结果_中间箍筋距离 = Panel(dist_2)

# ---- group: 主筋
cull_i = CullIndex(List=ext, Indices=0, Wrap=True)

# ----
panel_27 = Panel(offset_14)

pipe_15 = Pipe(Curve=cull_i, Radius=主筋半径, Caps=1)
col_14 = Colour(RGB(217, 56, 255))
preview_13 = CustomPreview(Geometry=pipe_15, Material=col_14)

cluster_6 = Cluster_2(L=offset_14)
panel_28 = Panel(cull_i)
fillet_10 = Fillet(Curve=[split_5.ListA, offset_15, cluster_6], Radius=箍筋倒角)

箍筋半径_3 = Slider(15, range=0..100)
pipe_16 = Pipe(Curve=fillet_10, Radius=箍筋半径, Caps=0)
col_15 = Colour(RGB(29, 237, 255))
preview_14 = CustomPreview(Geometry=pipe_16, Material=col_15)

Z_28 = UnitZ(Factor=expr("-x", vb_2.A))
move_24 = Move(Geometry=offset_10, Motion=Z_28)  # -> Geometry, Transform
item_28 = ListItem(List=move_24.Geometry, Index=4, Wrap=True)
item_29 = ListItem(List=move_24.Geometry, Index=5, Wrap=True)
item_30 = ListItem(List=move_24.Geometry, Index=6, Wrap=True)
item_31 = ListItem(List=move_24.Geometry, Index=7, Wrap=True)
ccx_13 = CurveCurve(CurveA=graft(item_28), CurveB=item_29)  # -> Points, ParamsA, ParamsB
ccx_14 = CurveCurve(CurveA=graft(item_29), CurveB=item_30)  # -> Points, ParamsA, ParamsB
ccx_15 = CurveCurve(CurveA=graft(item_30), CurveB=item_31)  # -> Points, ParamsA, ParamsB
ccx_16 = CurveCurve(CurveA=graft(item_31), CurveB=item_28)  # -> Points, ParamsA, ParamsB
ln_15 = Line(StartPoint=ccx_13.Points, EndPoint=ccx_16.Points)
ln_16 = Line(StartPoint=ccx_14.Points, EndPoint=ccx_15.Points)
len_14 = Length(Curve=[ln_15, ln_16])
division_15 = Division(A=len_14, B=Slider(150, range=0..1000))
divide_16 = DivideCurve(Curve=ln_16, Count=division_15, Kinks=False)  # -> Points, Tangents, Parameters
divide_17 = DivideCurve(Curve=ln_15, Count=division_15, Kinks=False)  # -> Points, Tangents, Parameters
Z_29 = UnitZ(Factor=1)
line_30 = LineSDL(Start=[divide_17.Points, divide_16.Points], Direction=Z_29, Length=expr("-x", Slider(160, range=0..1000)))
ln_17 = Line(StartPoint=divide_17.Points, EndPoint=divide_16.Points)
join_6 = JoinCurves(Curves=[ln_17, line_30], Preserve=False)
number_slider_31 = Slider(15, range=0..100)
fillet_11 = Fillet(Curve=join_6, Radius=25)

move_25 = Move(Geometry=[ccx_13.Points, ccx_14.Points, ccx_15.Points, ccx_16.Points], Motion=expr("-x", Z_13))  # -> Geometry, Transform

X_4 = UnitX(Factor=expr("-x", number_slider_22))
line_31 = LineSDL(Start=ccx_15.Points, Direction=Z_14, Length=expr("-x", number_slider_21))
Y_2 = UnitY(Factor=number_slider_22)
move_26 = Move(Geometry=line_31, Motion=Y_2)  # -> Geometry, Transform
move_27 = Move(Geometry=move_26.Geometry, Motion=X_4)  # -> Geometry, Transform

len_15 = Length(Curve=move_27.Geometry)
division_16 = Division(A=len_15, B=Slider(150, range=0..1000))

line_32 = LineSDL(Start=ccx_13.Points, Direction=Z_14, Length=expr("-x", number_slider_21))
Y_3 = UnitY(Factor=number_slider_22)
X_5 = UnitX(Factor=number_slider_22)
move_28 = Move(Geometry=line_32, Motion=expr("-x", Y_3))  # -> Geometry, Transform
move_29 = Move(Geometry=move_28.Geometry, Motion=X_5)  # -> Geometry, Transform

Y_4 = UnitY(Factor=expr("-x", number_slider_22))
X_6 = UnitX(Factor=expr("-x", number_slider_22))
line_33 = LineSDL(Start=ccx_16.Points, Direction=Z_14, Length=expr("-x", number_slider_21))
move_30 = Move(Geometry=line_33, Motion=Y_4)  # -> Geometry, Transform
move_31 = Move(Geometry=move_30.Geometry, Motion=X_6)  # -> Geometry, Transform

len_16 = Length(Curve=move_31.Geometry)
division_17 = Division(A=len_16, B=Slider(150, range=0..1000))

line_34 = LineSDL(Start=ccx_14.Points, Direction=Z_14, Length=expr("-x", number_slider_21))
Y_5 = UnitY(Factor=number_slider_22)
X_7 = UnitX(Factor=number_slider_22)
move_32 = Move(Geometry=line_34, Motion=Y_5)  # -> Geometry, Transform
move_33 = Move(Geometry=move_32.Geometry, Motion=X_7)  # -> Geometry, Transform

divide_18 = DivideCurve(Curve=move_31.Geometry, Count=division_17, Kinks=False)  # -> Points, Tangents, Parameters
pframes = PerpFrames(Curve=move_31.Geometry, Count=division_17, Align=True)  # -> Frames, Parameters
pframes_2 = PerpFrames(Curve=move_29.Geometry, Count=division_17, Align=True)  # -> Frames, Parameters
divide_19 = DivideCurve(Curve=move_29.Geometry, Count=division_17, Kinks=False)  # -> Points, Tangents, Parameters
number_slider_32 = Slider(150, range=0..1000)
ln_18 = Line(StartPoint=divide_18.Points, EndPoint=divide_19.Points)
line_35 = LineSDL(Start=divide_18.Points, Direction=ln_18, Length=number_slider_32)
line_36 = LineSDL(Start=divide_19.Points, Direction=ln_18, Length=number_slider_32)
rad = Radians(Degrees=Slider(90, range=0..100))
rotate_2 = Rotate(Geometry=line_36, Angle=expr("-x", rad), Plane=pframes_2.Frames)  # -> Geometry, Transform
rotate_3 = Rotate(Geometry=line_35, Angle=expr("-x", rad), Plane=pframes.Frames)  # -> Geometry, Transform
join_7 = JoinCurves(Curves=[rotate_2.Geometry, rotate_3.Geometry, ln_18], Preserve=False)
fillet_12 = Fillet(Curve=join_7, Radius=Slider(25, range=0..100))
remove_list_first_last = Cluster_2(L=fillet_12)
pipe_17 = Pipe(Curve=fillet_12, Radius=number_slider_31, Caps=1)
col_16 = Colour(RGB(40, 210, 255))
preview_15 = CustomPreview(Material=col_16)

divide_20 = DivideCurve(Curve=move_31.Geometry, Count=division_16, Kinks=False)  # -> Points, Tangents, Parameters
pframes_3 = PerpFrames(Curve=move_31.Geometry, Count=division_16, Align=True)  # -> Frames, Parameters
divide_21 = DivideCurve(Curve=move_27.Geometry, Count=division_16, Kinks=False)  # -> Points, Tangents, Parameters
pframes_4 = PerpFrames(Curve=move_27.Geometry, Count=division_16, Align=True)  # -> Frames, Parameters
number_slider_33 = Slider(150, range=0..1000)
ln_19 = Line(StartPoint=divide_21.Points, EndPoint=divide_20.Points)
line_37 = LineSDL(Start=divide_21.Points, Direction=ln_19, Length=number_slider_33)
line_38 = LineSDL(Start=divide_20.Points, Direction=ln_19, Length=number_slider_33)
rad_2 = Radians(Degrees=Slider(90, range=0..100))
rotate_4 = Rotate(Geometry=line_38, Angle=expr("-x", rad_2), Plane=pframes_3.Frames)  # -> Geometry, Transform
rotate_5 = Rotate(Geometry=line_37, Angle=expr("-x", rad_2), Plane=pframes_4.Frames)  # -> Geometry, Transform
join_8 = JoinCurves(Curves=[rotate_4.Geometry, rotate_5.Geometry, ln_19], Preserve=False)
fillet_13 = Fillet(Curve=join_8, Radius=Slider(25, range=0..100))
remove_list_first_last_2 = Cluster_2(L=fillet_13)
pipe_18 = Pipe(Curve=fillet_13, Radius=number_slider_31, Caps=1)
col_17 = Colour(RGB(40, 210, 255))
preview_16 = CustomPreview(Geometry=pipe_18, Material=col_17)

cluster_7 = Cluster_2(L=fillet_11)

pipe_19 = Pipe(Curve=cluster_7, Radius=number_slider_31, Caps=1)

preview_17 = CustomPreview(Geometry=pipe_19, Material=col_3)

len_17 = Length(Curve=move_29.Geometry)
division_18 = Division(A=len_17, B=Slider(150, range=0..1000))

len_18 = Length(Curve=move_27.Geometry)
division_19 = Division(A=len_18, B=Slider(150, range=0..1000))

divide_22 = DivideCurve(Curve=move_29.Geometry, Count=division_18, Kinks=False)  # -> Points, Tangents, Parameters
divide_23 = DivideCurve(Curve=move_33.Geometry, Count=division_18, Kinks=False)  # -> Points, Tangents, Parameters
number_slider_34 = Slider(150, range=0..1000)
pframes_5 = PerpFrames(Curve=move_29.Geometry, Count=division_18, Align=True)  # -> Frames, Parameters
pframes_6 = PerpFrames(Curve=move_33.Geometry, Count=division_18, Align=True)  # -> Frames, Parameters
ln_20 = Line(StartPoint=divide_22.Points, EndPoint=divide_23.Points)
line_39 = LineSDL(Start=divide_22.Points, Direction=ln_20, Length=number_slider_34)
line_40 = LineSDL(Start=divide_23.Points, Direction=ln_20, Length=number_slider_34)
rad_3 = Radians(Degrees=Slider(90, range=0..100))
rotate_6 = Rotate(Geometry=line_40, Angle=expr("-x", rad_3), Plane=pframes_6.Frames)  # -> Geometry, Transform
rotate_7 = Rotate(Geometry=line_39, Angle=expr("-x", rad_3), Plane=pframes_5.Frames)  # -> Geometry, Transform
join_9 = JoinCurves(Curves=[rotate_6.Geometry, rotate_7.Geometry, ln_20], Preserve=False)
fillet_14 = Fillet(Curve=join_9, Radius=Slider(25, range=0..100))
remove_list_first_last_3 = Cluster_2(L=fillet_14)
pipe_20 = Pipe(Curve=fillet_14, Radius=number_slider_31, Caps=1)
col_18 = Colour(RGB(40, 210, 255))
preview_18 = CustomPreview(Geometry=pipe_20, Material=col_18)

divide_24 = DivideCurve(Curve=move_33.Geometry, Count=division_19, Kinks=False)  # -> Points, Tangents, Parameters
number_slider_35 = Slider(150, range=0..1000)
pframes_7 = PerpFrames(Curve=move_33.Geometry, Count=division_19, Align=True)  # -> Frames, Parameters
divide_25 = DivideCurve(Curve=move_27.Geometry, Count=division_19, Kinks=False)  # -> Points, Tangents, Parameters
pframes_8 = PerpFrames(Curve=move_27.Geometry, Count=division_19, Align=True)  # -> Frames, Parameters
ln_21 = Line(StartPoint=divide_24.Points, EndPoint=divide_25.Points)
line_41 = LineSDL(Start=divide_24.Points, Direction=ln_21, Length=number_slider_35)
line_42 = LineSDL(Start=divide_25.Points, Direction=ln_21, Length=number_slider_35)
rad_4 = Radians(Degrees=Slider(90, range=0..100))
rotate_8 = Rotate(Geometry=line_42, Angle=expr("-x", rad_4), Plane=pframes_8.Frames)  # -> Geometry, Transform
rotate_9 = Rotate(Geometry=line_41, Angle=expr("-x", rad_4), Plane=pframes_7.Frames)  # -> Geometry, Transform
join_10 = JoinCurves(Curves=[rotate_8.Geometry, rotate_9.Geometry, ln_21], Preserve=False)
fillet_15 = Fillet(Curve=join_10, Radius=Slider(25, range=0..100))
remove_list_first_last_4 = Cluster_2(L=fillet_15)
pipe_21 = Pipe(Curve=fillet_15, Radius=number_slider_31, Caps=1)
col_19 = Colour(RGB(231, 211, 54))

move_34 = Move(Geometry=[pipe_17, pipe_21], Motion=unit_z_7)  # -> Geometry, Transform

preview_19 = CustomPreview(Geometry=move_34.Geometry, Material=col_19)

# ==== cluster Cluster
x = ClusterInput()
x_2 = ClusterInput()
x_3 = ClusterInput()
x_4 = ClusterInput()
x_5 = ClusterInput()
expression = Expression(x=x, Expression="x*¼")
expression_2 = Expression(x=x_2, Expression="x*½")
expression_3 = Expression(x=x_3, Expression="x*⅓")
expression_4 = Expression(x=x_4, Expression="x*¾")
c_script = CSharpScript(x=x_5)  # -> A; inputs x: Double
# ---------- c_script: C# ----------
    if(x % 2 == 0)
    {
      A = x / 3;
    }else if (x % 2 == 1)
    {
      A = (x / 3) + 1;
    }
# ---------- end c_script ----------
R = ClusterOutput(expression)
R_2 = ClusterOutput(expression_2)
R_3 = ClusterOutput(expression_3)
R_4 = ClusterOutput(expression_4)
A = ClusterOutput(c_script)

# ==== cluster Cluster_2
L = ClusterInput()

# ---- group: remove first and last
split = SplitList(List=L, Index=1)  # -> ListA, ListB
lng = ListLength(List=split.ListB)
subtraction = Subtraction(A=lng, B=1)
split_2 = SplitList(List=split.ListB, Index=subtraction)  # -> ListA, ListB

# ----
A = ClusterOutput(split_2.ListA)

# ==== cluster Cluster_3
S = ClusterInput()
D = ClusterInput()
L = ClusterInput()
S_2 = ClusterInput()
D_2 = ClusterInput()
L_2 = ClusterInput()
line = LineSDL(Start=S, Direction=D, Length=expr("-x", L))
line_2 = LineSDL(Start=S_2, Direction=D_2, Length=L_2)
join = JoinCurves(Curves=[line_2, line], Preserve=False)
C = ClusterOutput(join)
