# Grasshopper definition 盖梁模型.gh (Grasshopper 1.0.7)

brep = Brep(<brep referenced from the Rhino model>)
deconstruct_brep = DeconstructBrep(Brep=brep)  # -> Faces, Edges, Vertices
offset_surface = OffsetSurface(Surface=deconstruct_brep.Faces, Distance=Slider(-100, range=-1000..1000), Retrim=True)
deconstruct_brep_2 = DeconstructBrep(Brep=offset_surface)  # -> Faces, Edges, Vertices

# ----
# 筛选出断面的顶部
筛选出断面的顶部 = ListItem(List=flatten(deconstruct_brep_2.Edges), Index=Slider(50, range=0..100), Wrap=True)

number_slider = Slider(100, range=0..100)
extend_curve = ExtendCurve(Curve=筛选出断面的顶部, Type=0, Start=expr("-x", number_slider), End=expr("-x", number_slider))
c_script = CSharpScript(x=筛选出断面的顶部)  # -> out, A; inputs x: Line
# ---------- c_script: C# ----------
    double aa = 1.0;
    aa = x.Length;
    double bb = aa / 150;
    A = bb;
# ---------- end c_script ----------
筛选出断面的顶部_2 = ListItem(List=flatten(deconstruct_brep_2.Faces), Index=[11, 15], Wrap=True)
divide_curve = DivideCurve(Curve=extend_curve, Count=c_script.A, Kinks=False)  # -> Points, Tangents, Parameters
mesh_join = MeshJoin(Meshes=筛选出断面的顶部_2)
perp_frame = PerpFrame(Curve=extend_curve, Parameter=divide_curve.Parameters)  # -> flatten(Frame)
panel = Panel(mesh_join)
mesh_plane = MeshPlane(Mesh=graft(筛选出断面的顶部_2), Plane=perp_frame)
shift_paths = ShiftPaths(Data=mesh_plane, Offset=-1)  # -> simplify(Data)
explode_tree = ExplodeTree(Data=shift_paths)  # -> Branch0, Branch1
number_slider_2 = Slider(371, range=0..1000)
number_slider_3 = Slider(1000, range=0..1000)
panel_2 = Panel(shift_paths)
extend_curve_2 = ExtendCurve(Curve=explode_tree.Branch0, Type=0, Start=number_slider_2, End=0)
extend_curve_3 = ExtendCurve(Curve=explode_tree.Branch1, Type=0, Start=0, End=number_slider_2)
param_viewer = ParamViewer()
